# Grasshopper definition Block.gh (Grasshopper 1.0.7)
# plug-ins: Bifocals, LunchBox

# ---- group: Input Data
file_path = FilePath("D:\OptimizationInArchitect_Rahbar\Optimiz_Lessen4\variables.csv")
read_file = ReadFile(File=file_path, PerLineParse=True)
read_csv = ReadCSV(CSVString=read_file, Delimiter=",")  # -> Headers, Values
explode_tree = ExplodeTree(Data=read_csv.Values)  # -> Branch0, Branch1
panel = Panel(explode_tree.Branch0)
panel_2 = Panel(explode_tree.Branch1)

# ----
data_recorder = DataRecorder(Slider(4, range=4..30), DataLimit=-10, RecordData=True)
data_recorder_2 = DataRecorder(Slider(4, range=4..30), DataLimit=-10, RecordData=True)
data_recorder_3 = DataRecorder(Slider(4, range=4..30), DataLimit=-10, RecordData=True)
data_recorder_4 = DataRecorder(Slider(4, range=4..30), DataLimit=-10, RecordData=True)
data_recorder_5 = DataRecorder(Slider(4, range=4..30), DataLimit=-10, RecordData=True)
data_recorder_6 = DataRecorder(Slider(4, range=4..30), DataLimit=-10, RecordData=True)
data_recorder_7 = DataRecorder(Slider(4, range=4..30), DataLimit=-10, RecordData=True)
data_recorder_8 = DataRecorder(Slider(4, range=4..30), DataLimit=-10, RecordData=True)
data_recorder_9 = DataRecorder(Slider(4, range=4..30), DataLimit=-10, RecordData=True)
data_recorder_10 = DataRecorder(Slider(4, range=4..30), DataLimit=-10, RecordData=True)
data_recorder_11 = DataRecorder(Slider(4, range=4..30), DataLimit=-10, RecordData=True)
data_recorder_12 = DataRecorder(Slider(4, range=4..30), DataLimit=-10, RecordData=True)
data_recorder_13 = DataRecorder(Slider(4, range=4..30), DataLimit=-10, RecordData=True)
data_recorder_14 = DataRecorder(Slider(4, range=4..30), DataLimit=-10, RecordData=True)
list_item = ListItem(List=panel_2, Index=0, Wrap=True)  # -> Item, Item1, Item2, Item3
number_slider = Slider(1.37, range=0.5..2)
number_slider_2 = Slider(10, range=4..30)
data_recorder_15 = DataRecorder(number_slider_2, DataLimit=-10, RecordData=True)
number_slider_3 = Slider(8, range=4..30)
data_recorder_16 = DataRecorder(number_slider_3, DataLimit=-10, RecordData=True)
number_slider_4 = Slider(20, range=4..30)
data_recorder_17 = DataRecorder(number_slider_4, DataLimit=-10, RecordData=True)
data_recorder_18 = DataRecorder(number_slider, DataLimit=-10, RecordData=True)
point = Point(Point(42.66880405, -39.80570071, 0))

# ---- group: Output
random = Random(Range="0 to 100", Number="10", Seed=Slider(234, range=0..1000))
panel_3 = Panel(random)
create_csv = CreateCSV(DataGridHeaders="vars", ValueTree=panel_3, Delimiter=",")
panel_4 = Panel(create_csv)

# ----
panel_5 = Panel("""TotalRadiation
Volume
Area""")

# ----
# Urban Block
ladybug = Ladybug_Ladybug()  # -> out; plug-in component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
curve = Curve([<curve referenced from the Rhino model> x3])
unit_z = UnitZ(Factor=[number_slider_2, number_slider_3, number_slider_4])
number_slider_5 = Slider(237, range=0..360)
unit_z_2 = UnitZ(Factor=1)

scale = Scale(Geometry=curve, Center=point, Factor=number_slider)  # -> Geometry, Transform

surface = Surface(scale.Geometry)
rotate_3d = Rotate3D(Geometry=surface, Angle=degrees(number_slider_5), Center=point, Axis=unit_z_2)  # -> Geometry, Transform
extrude = Extrude(Base=rotate_3d.Geometry, Direction=unit_z)

data_recorder_19 = DataRecorder(number_slider_5, DataLimit=-10, RecordData=True)
volume = Volume(Geometry=extrude)  # -> Volume, Centroid
area = Area(Geometry=extrude)  # -> Area, Centroid
ghpython_script = GhPythonScript(x=volume.Volume)  # -> out, a; inputs x: list
# ---------- ghpython_script: Python ----------
__author__ = "omid"
__version__ = "2021.06.25"


a=sum(x)
# ---------- end ghpython_script ----------
ghpython_script_2 = GhPythonScript(x=area.Area)  # -> out, a; inputs x: list; same code as ghpython_script

# ---- group: Radiation
# Solar Radiation
boolean_toggle = BooleanToggle(True)
brep = Brep(extrude)
file_path_2 = FilePath("G:\Article Writting\Solar Radiation\Article_Optimize_Solar rasiation\BlockForm\IRN_BK_Kermanshah.407720_TMYx\IRN_BK_Kermanshah.407720_TMYx.epw")
number_slider_6 = Slider(7, range=0..10)
gencumulativeskymtx = Ladybug_GenCumulativeSkyMtx(epwFile=file_path_2, skyDensity=0, useOldRes=True, runIt=boolean_toggle)  # -> out, cumulativeSkyMtx; plug-in component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
analysisperiod = Ladybug_AnalysisPeriod(
    fromMonth=Slider(1, range=1..12),
    fromDay=Slider(1, range=1..30),
    fromHour=Slider(1, range=1..24),
    toMonth=Slider(12, range=1..12),
    toDay=Slider(30, range=1..30),
    toHour=Slider(24, range=1..24))  # -> out, analysisPeriod; plug-in component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
settings_custom = SettingsCustom(
    StitchSeams=True,
    SimplePlanes=False,
    Refine=True,
    MinCount=16,
    MaxCount=400,
    AspectRatio=20,
    MaxDistance=0,
    MaxAngle=20,
    MinEdge=number_slider_6,
    MaxEdge=number_slider_6)
selectskymtx = Ladybug_selectSkyMtx(
    cumulativeSkyMtx=gencumulativeskymtx.cumulativeSkyMtx,
    analysisPeriod=analysisperiod.analysisPeriod,
    removeDiffuse=False,
    removeDirect=False)  # -> out, selectedSkyMtx; plug-in component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
mesh_brep = MeshBrep(Brep=brep, Settings=settings_custom)
radiationanalysis = Ladybug_RadiationAnalysis(
    geometry=flatten(mesh_brep),
    gridSize=Slider(15, range=0..20),
    disFromBase=Slider(0.1, range=0..0.1),
    selectedSkyMtx=flatten(selectskymtx.selectedSkyMtx),
    parallel=Toggle(True),
    runIt=Toggle(True))  # -> out, contextMesh, analysisMesh, testPts, testVec, port, radiationResult, radiationMesh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; plug-in component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

# ----
volume_2 = Volume(Geometry=brep)  # -> Volume, Centroid

# ----
# visulaization
number_slider_7 = Slider(1.66, range=1..20)
number = Number(unit_z)
circle_cnr = CircleCNR(Center=volume_2.Centroid, Normal=Vector(0, 0, 1), Radius=number_slider_7)
number_2 = Number(number)
unit_z_3 = UnitZ(Factor=expr("(.5*x)+(.02*x)", number_2))
move = Move(Geometry=circle_cnr, Motion=unit_z_3)  # -> Geometry, Transform
colour_swatch = ColourSwatch(SwatchColor=RGBA(206, 226, 143, 226))
brep_2 = Brep(move.Geometry)
area_2 = Area(Geometry=brep_2)  # -> Area, Centroid
text_tag_3d = TextTag3D(
    Location=area_2.Centroid,
    Text=number_2,
    Size=Slider(2, range=1..5),
    Colour=ColourSwatch(SwatchColor=RGB(5, 5, 5)),
    Justification=5)
custom_preview = CustomPreview(Geometry=brep_2, Material=colour_swatch)
custom_preview_2 = CustomPreview(Material=colour_swatch)

# ----
# visulaization
number_slider_8 = Slider(8, range=0..60)
point_2 = Point(Point(0.6653450784, -0.1483993457, 0))
circle_cnr_2 = CircleCNR(Center=point_2, Normal=Vector(0, 0, 1), Radius=number_slider_8)
brep_3 = Brep(circle_cnr_2)
area_3 = Area(Geometry=brep_3)  # -> Area, Centroid
colour_swatch_2 = ColourSwatch(SwatchColor=RGBA(0, 255, 229, 159))
text_tag_3d_2 = TextTag3D(
    Location=area_3.Centroid,
    Text=radiationanalysis.totalRadiation,
    Size=Slider(2.172, range=1..30),
    Colour=ColourSwatch(SwatchColor=RGBA(0, 0, 0, 226)),
    Justification=5)
custom_preview_3 = CustomPreview(Geometry=brep_3, Material=colour_swatch_2)
custom_preview_4 = CustomPreview(Geometry=brep_3, Material=colour_swatch_2)

totalradiation = Number(radiationanalysis.totalRadiation)
volume_3 = Number(ghpython_script.a)
area_4 = Number(ghpython_script_2.a)
create_csv_2 = CreateCSV(DataGridHeaders=panel_5, ValueTree=[totalradiation, volume_3, area_4], Delimiter=",")
panel_6 = Panel(create_csv_2)
